# Grasshopper definition Realtime_serial.gh (Grasshopper 0.9.76)
# plug-ins: Python Interpreter, Firefly.Core

# ---- group: Communication w/ serial port
# Realtime serial reading
# Computational Design by Adrien Rigobello
# adrienr@protonmail.com
# Twitter: @tubuscas
ports_available = COMPortsAvailable()
com_port = Panel(ports_available)
concat = Concatenate(FragmentA="COM", FragmentB=ports_available)
open_close_port = BooleanToggle(False)
timer = Timer(TimerInterval=500, Target=open_close_port)  # disabled
baudrate = Panel("9600")
python = PythonScript(x=baudrate, y=concat, z=open_close_port)  # -> out
# ---------- python: Python ----------
import sys
sys.path.append("C:\Program Files (x86)\IronPython 2.7\Lib\pyserial-3.3")
import serial

myPort=serial.Serial()
myPort.baudrate = x
myPort.port = y

if z == True:
    try:
        myPort.open()
    except:
        print "Something went wrong. Cannot open port."
    if myPort.isOpen() == True:
        print myPort.name + " is open"
        print myPort.readline()
        myPort.close()

if z != True:
    try:
        myPort.close()
    except:
        print "Something went wrong. Cannot close port."
    if myPort.isOpen() != True:
        print myPort.name + " is closed"
# ---------- end python ----------
number_slider = Slider(10, range=0..100)
item = ListItem(List=python, Index="1", Wrap=True)
panel = Panel(python)
log = DataLog(
    IncomingData=item,
    ResetLog=Toggle(False),
    StartRecording=True,
    WrapValues=Toggle(True),
    RecordingLength=number_slider,
    OptionalFilePath="c:\your_path")
panel_2 = Panel(item)
panel_3 = Panel(log)
split = TextSplit(Text=log, Separators=":")
item_2 = ListItem(List=split, Index="2", Wrap=True)
item_3 = ListItem(List=split, Index="3", Wrap=True)
split_2 = TextSplit(Text=[item_2, item_3], Separators=" ")
item_4 = ListItem(List=split_2, Index="2", Wrap=True)
split_3 = TextSplit(Text=item_4, Separators=",")
item_5 = ListItem(List=split_3, Index="0", Wrap=True)  # -> flatten(Item)
dispatch = Dispatch(List=item_5, DispatchPattern=[True, False])  # -> ListA, ListB
bg = Panel(dispatch.ListA)
signal = Panel(dispatch.ListB)

# ----
number_slider_2 = Slider(12, range=0..100)
addition = Addition(A=number_slider_2, B=5)
number_of_values_in_the_batch = Integer(number_slider)
panel_4 = Panel("")  # disabled
series = Series(Start=addition, Step=addition, Count=expr("x-1", number_of_values_in_the_batch))
division = Division(A=dispatch.ListB, B=panel_4)  # disabled
rectangle = Rectangle(Plane=PlaneXY(0, 0, 0), XSize=number_slider_2, YSize=number_slider_2, Radius=0)  # -> Rectangle, Length
X = UnitX(Factor=series)
Z = UnitZ(Factor=dispatch.ListB)
move = Move(Geometry=rectangle.Rectangle, Motion=X)  # -> flatten(Geometry), Transform
bnd = Bounds(Numbers=dispatch.ListA)
dedomain = DeconstructDomain(Domain=bnd)  # -> Start, End
merge = Merge(Data1=rectangle.Rectangle, Data2=move.Geometry)
gradient = Gradient(
    LowerLimit=dedomain.Start,
    UpperLimit=dedomain.End,
    Parameter=dispatch.ListA,
    stops=[0: RGB(0, 128, 0), 0.5: RGB(255, 255, 0), 1: RGB(255, 0, 0)])
extr = Extrude(Base=merge, Direction=Z)
cap = CapHoles(Brep=extr)
brep = Brep(cap)
preview = CustomPreview(Geometry=brep, Shader=gradient)
